# Grasshopper definition MdJarifAlam_1901014_GeoDesicDome.gh (Grasshopper 1.0.7)
# plug-ins: GhPolyhedra, LunchBox

# ---- group: GEODESIC DOME CONSTRUCTION
icosphere = IcoSphere(Plane=PlaneXY(0, 0, 0), Scale=Slider(7.6, range=0..100), Density=Slider(2, range=0..10))
face_boundaries = FaceBoundaries(Mesh=icosphere)
boundary_surfaces = BoundarySurfaces(Edges=face_boundaries)
brep_join = BrepJoin(Breps=boundary_surfaces)  # -> Breps, Closed
deconstruct_brep = DeconstructBrep(Brep=brep_join.Breps)  # -> Faces, Edges, Vertices

# ---- group: SUN
curve = Curve(<curve referenced from the Rhino model>)
evaluate_curve = EvaluateCurve(Curve=curve, Parameter=Slider(139.519, range=0..190))  # -> Point, Tangent, Angle

# ---- group: PANEL APERTURE SIZE
area = Area(Geometry=deconstruct_brep.Faces)  # -> Area, Centroid
pull_point = PullPoint(Point=area.Centroid, Geometry=evaluate_curve.Point, ClosestOnly=True)  # -> ClosestPoint, Distance
construct_domain = ConstructDomain(DomainStart=Slider(0.75, range=0.1..0.9), DomainEnd=Slider(0.042, range=0..1))
minimum = Minimum(A=pull_point.Distance, B=Slider(2000, range=0..2000))
bounds = Bounds(Numbers=minimum)
remap_numbers = RemapNumbers(Value=minimum, Source=bounds, Target=construct_domain)  # -> Mapped, Clipped

# ---- group: PANEL
panel_frame = PanelFrame(Panel=deconstruct_brep.Faces, ScaleFactor=remap_numbers.Clipped)  # -> PanelFrame, Panel
brep = Brep(panel_frame.PanelFrame)
brep_2 = Brep(panel_frame.Panel)
brep_join_2 = BrepJoin(Breps=brep)  # -> Breps, Closed

# ---- group: JOINT
sphere = Sphere(Base=deconstruct_brep.Vertices, Radius=Slider(0.3, range=0..1))

# ---- group: DOME PIPES
pipe = Pipe(Curve=deconstruct_brep.Edges, Radius=Slider(0.15, range=0..1), Caps=0)

# ----
brep_3 = Brep(<brep referenced from the Rhino model>)
split_brep = SplitBrep(Brep=brep_join_2.Breps, Cutter=brep_3)
dispatch = Dispatch(List=split_brep, DispatchPattern=[True, False])  # -> ListA, ListB
brep_4 = Brep(dispatch.ListB)
brep_5 = Brep(dispatch.ListA)

brep_join_3 = BrepJoin(Breps=brep_5)  # -> Breps, Closed
